# Dynamo graph Opening Genrator V 1.2.dyn (Dynamo 2.12.1.8246)
# packages: spring nodes 210.1.1, bimorphNodes 4.2.4, Rhythm 2023.7.1

# group: INPUT
boolean = BoolSelector(true)
select_the_plumbing_link = DSModelElementSelection()  # 1 picked in the model; graph input

# group: DUCT AND PIPES CATEGORY
categories = Categories("OST_Walls")
string_from_object = FromObject(object=categories)
customISelectionFilter = Python(IN[0]=boolean, IN[1]=string_from_object)  # IronPython2
# ---------- customISelectionFilter.python (46 lines) ----------
#Copyright(c) 2017, john pierson
# @60secondrevit, http://sixtysecondrevit.com
#Sometimes a pick selection is better
#Based on a node from Dimitar Venkov

import clr

clr.AddReference("RevitAPIUI")
from  Autodesk.Revit.UI import *

clr.AddReference("RevitServices")
import RevitServices
from RevitServices.Persistence import DocumentManager
doc = DocumentManager.Instance.CurrentDBDocument
uidoc=DocumentManager.Instance.CurrentUIApplication.ActiveUIDocument

clr.AddReference("RevitNodes")
import Revit
clr.ImportExtensions(Revit.Elements)
TaskDialog.Show('Selection For Wall opening','Pick The Wall. in which you want to creat opening for pipes and ducts , Press finish to complete.')

sel1 = uidoc.Selection
obt1 = Selection.ObjectType.Element
class CustomISelectionFilter(Selection.ISelectionFilter):
	def __init__(self, nom_categorie):
		self.nom_categorie = nom_categorie
	def AllowElement(self, e):
		if e.Category.Name == self.nom_categorie:
			return True
		else:
			return False
	def AllowReference(self, ref, point):
		return true
		
el_ref = sel1.PickObjects(obt1, CustomISelectionFilter(IN[1]), 'Pick elements of category, ' + (IN[1].lower()) + ' Press finish to complete.')
typelist = list()
idlist = list()
for i in el_ref:
	
	try:
		typelist.append(doc.GetElement(i.ElementId))
	except:
		typelist.apped(list())
		

OUT = typelist
# ----------------------------------------
code_block = CodeBlock { 1; }
chop = List.Chop(list=customISelectionFilter, lengths=code_block)
categories_2 = Categories("OST_DuctCurves")
ofCategory = Revit.LinkElement.OfCategory(linkInstance=select_the_plumbing_link, category=categories_2)
element_geometry_duct = Element.Geometry(element=ofCategory)

# group: is pipe intersect
geometry = Element.Geometry(element=customISelectionFilter)
doesIntersect = Geometry.DoesIntersect(geometry=element_geometry_duct, other=geometry@L1)
code_block_2 = CodeBlock { 2; }
flatten = List.Flatten(list=doesIntersect@L3, amount=code_block_2)
filterByBoolMask = List.FilterByBoolMask(list=element_geometry_duct, mask=flatten@L2)
code_block_3 = CodeBlock { 2; }
code_block_4 = CodeBlock { 2; }
filterByBoolMask_2 = List.FilterByBoolMask(list=ofCategory, mask=flatten@L2)
watch = Watch(filterByBoolMask_2.in)

flatten_2 = List.Flatten(list=filterByBoolMask.in@L3, amount=code_block_3)

# group (continued): is pipe intersect
watch_2 = Watch(flatten_2)

flatten_3 = List.Flatten(list=geometry)

# group (continued): is pipe intersect
intersectAll = Geometry.IntersectAll(geometry=watch_2, others=flatten_3@L1, lacing=CrossProduct)
flatten_4 = List.Flatten(list=intersectAll@L4, amount=code_block_4)
centroid = Solid.Centroid(solid=flatten_4)

# group: Duct Data
code_block_5 = CodeBlock { "Height"; }
getParameterValueByName = Element.GetParameterValueByName(element=watch, parameterName=code_block_5)
clean = List.Clean(list=getParameterValueByName)
code_block_6 = CodeBlock { "Insulation Thickness"; }
getParameterValueByName_2 = Element.GetParameterValueByName(element=watch, parameterName=code_block_6)
code_block_7 = CodeBlock { "Width"; }
getParameterValueByName_3 = Element.GetParameterValueByName(element=watch, parameterName=code_block_7)
clean_2 = List.Clean(list=getParameterValueByName_3)
count = List.Count(list=clean_2@L2)
takeItems = List.TakeItems(list=getParameterValueByName_2, amount=count@L1)
code_block_8 = CodeBlock { 2; }
flatten_5 = List.Flatten(list=takeItems@L3, amount=code_block_8)

# group: Assign Width & Height
code_block_9 = CodeBlock(b=clean, a=flatten_5) { b+(a*2); }
string = StringInput("Width")
code_block_10 = CodeBlock(b=clean_2, a=flatten_5) { b+(a*2); }
string_2 = StringInput("Height")

# group: Get The Opening
string_3 = StringInput("ID-DUCT OPENING")
byName = Family.ByName(name=string_3)
types = Family.Types(family=byName)
ZAxis = Vector.ZAxis()
code_block_11 = CodeBlock(a=code_block_9) { -a/2; }
translate = Geometry.Translate(geometry=centroid, direction=ZAxis, distance=code_block_11)
ꟿ_familyinstance_byhostandpoint = Custom[ꟿ FamilyInstance.ByHostAndPoint](host=chop, type=types, point=translate)  # package spring nodes; Creates hosted family instances(doors/windows) at the specified points. You can feed either a single family type or a unique type for each instance.

# group (continued): Assign Width & Height
ʳʰʸᵗʰᵐ_elements = Rhythm.Revit.Elements.Elements.SetParameterByNameTypeOrInstance(element=ꟿ_familyinstance_byhostandpoint, parameterName=string, value=code_block_10, lacing=Longest)
ʳʰʸᵗʰᵐ_elements_2 = Rhythm.Revit.Elements.Elements.SetParameterByNameTypeOrInstance(element=ꟿ_familyinstance_byhostandpoint, parameterName=string_2, value=code_block_9, lacing=Longest)
