# Dynamo graph Opening Genrator V 1.41.dyn "Opening Genrator V 1.4" (Dynamo 2.12.1.8246)
# packages: spring nodes 210.1.1, bimorphNodes 4.2.4, Rhythm 2023.7.1, Genius Loci 2023.1.23

# group: INPUT
boolean = BoolSelector(true)
categories = Categories("OST_RvtLinks")
all_elements_of_category = ElementsOfCategory(Category=categories)

# group: DUCT AND PIPES CATEGORY
categories_2 = Categories("OST_Walls")
string_from_object = FromObject(object=categories_2)
customISelectionFilter = Python(IN[0]=boolean, IN[1]=string_from_object)  # IronPython2
# ---------- customISelectionFilter.python (46 lines) ----------
#Copyright(c) 2017, john pierson
# @60secondrevit, http://sixtysecondrevit.com
#Sometimes a pick selection is better
#Based on a node from Dimitar Venkov

import clr

clr.AddReference("RevitAPIUI")
from  Autodesk.Revit.UI import *

clr.AddReference("RevitServices")
import RevitServices
from RevitServices.Persistence import DocumentManager
doc = DocumentManager.Instance.CurrentDBDocument
uidoc=DocumentManager.Instance.CurrentUIApplication.ActiveUIDocument

clr.AddReference("RevitNodes")
import Revit
clr.ImportExtensions(Revit.Elements)
TaskDialog.Show('Selection For Wall opening','Pick The Wall. in which you want to creat opening ducts , Press finish to complete.')

sel1 = uidoc.Selection
obt1 = Selection.ObjectType.Element
class CustomISelectionFilter(Selection.ISelectionFilter):
	def __init__(self, nom_categorie):
		self.nom_categorie = nom_categorie
	def AllowElement(self, e):
		if e.Category.Name == self.nom_categorie:
			return True
		else:
			return False
	def AllowReference(self, ref, point):
		return true
		
el_ref = sel1.PickObjects(obt1, CustomISelectionFilter(IN[1]), 'Pick elements of category, ' + (IN[1].lower()) + ' Press finish to complete.')
typelist = list()
idlist = list()
for i in el_ref:
	
	try:
		typelist.append(doc.GetElement(i.ElementId))
	except:
		typelist.apped(list())
		

OUT = typelist
# ----------------------------------------
code_block = CodeBlock { 1; }
chop = List.Chop(list=customISelectionFilter, lengths=code_block)
categories_3 = Categories("OST_DuctCurves")
ofCategory = Revit.LinkElement.OfCategory(linkInstance=all_elements_of_category, category=categories_3)
flatten = List.Flatten(list=ofCategory)
element_geometry_duct = Element.Geometry(element=flatten)
list_clean = Custom[List Clean](list=element_geometry_duct)  # package Genius Loci; Removes all Null, Empty and Blank from a list or nested list of lists.
categories_4 = Categories("OST_PipeCurves")
ofCategory_2 = Revit.LinkElement.OfCategory(linkInstance=all_elements_of_category, category=categories_4)
flatten_2 = List.Flatten(list=ofCategory_2)
element_geometry_duct_2 = Element.Geometry(element=flatten_2)

# group: is pipe intersect
geometry = Element.Geometry(element=customISelectionFilter)
flatten_3 = List.Flatten(list=geometry)
doesIntersect = Geometry.DoesIntersect(geometry=list_clean, other=geometry@L1)
code_block_2 = CodeBlock { 2; }
flatten_4 = List.Flatten(list=doesIntersect@L3, amount=code_block_2)
filterByBoolMask = List.FilterByBoolMask(list=list_clean, mask=flatten_4@L2)
code_block_3 = CodeBlock { 2; }
flatten_5 = List.Flatten(list=filterByBoolMask.in@L3, amount=code_block_3)
watch = Watch(flatten_5)
intersectAll = Geometry.IntersectAll(geometry=flatten_3, others=watch@L1, lacing=CrossProduct)
code_block_4 = CodeBlock { 2; }
flatten_6 = List.Flatten(list=intersectAll@L3, amount=code_block_4)
centroid = Solid.Centroid(solid=flatten_6)
pruneDuplicates = Point.PruneDuplicates(points=centroid)
list_clean_2 = Custom[List Clean](list=pruneDuplicates)
filterByBoolMask_2 = List.FilterByBoolMask(list=flatten, mask=flatten_4@L2)
watch_2 = Watch(filterByBoolMask_2.in)

# group: Get The Opening
string = StringInput("ID-DUCT OPENING")
byName = Family.ByName(name=string)
types = Family.Types(family=byName)
ꟿ_familyinstance_byhostandpoint = Custom[ꟿ FamilyInstance.ByHostAndPoint](host=chop, type=types, point=list_clean_2)  # package spring nodes; Creates hosted family instances(doors/windows) at the specified points. You can feed either a single family type or a unique type for each instance.

# group: Duct Data
code_block_5 = CodeBlock { "Width"; }
getParameterValueByName = Element.GetParameterValueByName(element=watch_2, parameterName=code_block_5)
clean = List.Clean(list=getParameterValueByName)
code_block_6 = CodeBlock { "Insulation Thickness"; }
getParameterValueByName_2 = Element.GetParameterValueByName(element=watch_2, parameterName=code_block_6)
count = List.Count(list=clean@L2)
takeItems = List.TakeItems(list=getParameterValueByName_2, amount=count@L1)
code_block_7 = CodeBlock { 2; }
flatten_7 = List.Flatten(list=takeItems@L3, amount=code_block_7)
code_block_8 = CodeBlock(a=flatten_7) { a+10; }
code_block_9 = CodeBlock { "Height"; }
getParameterValueByName_3 = Element.GetParameterValueByName(element=watch_2, parameterName=code_block_9)
clean_2 = List.Clean(list=getParameterValueByName_3)

# group: Assign Width & Height
string_2 = StringInput("Width")
code_block_10 = CodeBlock(b=clean, a=code_block_8) { b+(a*2); }
ʳʰʸᵗʰᵐ_elements = Rhythm.Revit.Elements.Elements.SetParameterByNameTypeOrInstance(element=ꟿ_familyinstance_byhostandpoint, parameterName=string_2, value=code_block_10, lacing=Longest)
string_3 = StringInput("Height")
code_block_11 = CodeBlock(b=clean_2, a=code_block_8) { b+(a*2); }
ʳʰʸᵗʰᵐ_elements_2 = Rhythm.Revit.Elements.Elements.SetParameterByNameTypeOrInstance(element=ꟿ_familyinstance_byhostandpoint, parameterName=string_3, value=code_block_11, lacing=Longest)

# group: Convert Curtin Wall To Solid
isEmpty = List.IsEmpty(list=geometry@L2)
filterByBoolMask_3 = List.FilterByBoolMask(list=chop, mask=isEmpty)
getLocation = Element.GetLocation(element=filterByBoolMask_3.in)
ZAxis = Vector.ZAxis()
code_block_12 = CodeBlock { "Unconnected Height"; }
getParameterValueByName_4 = Element.GetParameterValueByName(element=filterByBoolMask_3.in, parameterName=code_block_12)
code_block_13 = CodeBlock(a=getParameterValueByName_4) { a+2000; }
extrude = Curve.Extrude(curve=getLocation, direction=ZAxis, distance=code_block_13)
code_block_14 = CodeBlock { 100; }
code_block_15 = CodeBlock { true; }
thicken = Surface.Thicken(surface=extrude, thickness=code_block_14, both_sides=code_block_15)

# group: Test Location
endPoint = Curve.EndPoint(curve=getLocation)
X = Point.X(point=endPoint)
Z = Point.Z(point=endPoint)
startPoint = Curve.StartPoint(curve=getLocation)
Z_2 = Point.Z(point=startPoint)
X_2 = Point.X(point=startPoint)
Y = Point.Y(point=endPoint)
Y_2 = Point.Y(point=startPoint)
eq = Y == Y_2

# group: Wall
flatten_8 = List.Flatten(list=filterByBoolMask_3.in)

flatten_9 = List.Flatten(list=thicken)

# group: is pipe intersect
code_block_16 = CodeBlock { 2; }
doesIntersect_2 = Geometry.DoesIntersect(geometry=list_clean, other=thicken@L1)
code_block_17 = CodeBlock { 2; }
flatten_10 = List.Flatten(list=doesIntersect_2@L3, amount=code_block_17)
filterByBoolMask_4 = List.FilterByBoolMask(list=list_clean, mask=flatten_10@L2)
code_block_18 = CodeBlock { 2; }
flatten_11 = List.Flatten(list=filterByBoolMask_4.in@L3, amount=code_block_18)
watch_3 = Watch(flatten_11)
intersectAll_2 = Geometry.IntersectAll(geometry=flatten_9, others=watch_3@L1, lacing=CrossProduct)
code_block_19 = CodeBlock { 2; }
flatten_12 = List.Flatten(list=intersectAll_2@L3, amount=code_block_19)
centroid_2 = Solid.Centroid(solid=flatten_12)
filterByBoolMask_5 = List.FilterByBoolMask(list=flatten, mask=flatten_10@L2)

pruneDuplicates_2 = Point.PruneDuplicates(points=centroid_2)

# group (continued): is pipe intersect
list_clean_3 = Custom[List Clean](list=pruneDuplicates_2)

# group: Points
X_3 = Point.X(point=list_clean_3)
Y_3 = Point.Y(point=list_clean_3)
Z_3 = Point.Z(point=list_clean_3)

# group: Duct Data
code_block_20 = CodeBlock { "Width"; }
getParameterValueByName_5 = Element.GetParameterValueByName(element=filterByBoolMask_5.in, parameterName=code_block_20)
clean_3 = List.Clean(list=getParameterValueByName_5)
code_block_21 = CodeBlock { "Insulation Thickness"; }
getParameterValueByName_6 = Element.GetParameterValueByName(element=filterByBoolMask_5.in, parameterName=code_block_21)
count_2 = List.Count(list=clean_3@L2)
takeItems_2 = List.TakeItems(list=getParameterValueByName_6, amount=count_2@L1)
code_block_22 = CodeBlock { 2; }
flatten_13 = List.Flatten(list=takeItems_2@L3, amount=code_block_22)
code_block_23 = CodeBlock(a=flatten_13) { a+10; }
code_block_24 = CodeBlock { "Height"; }
getParameterValueByName_7 = Element.GetParameterValueByName(element=filterByBoolMask_5.in, parameterName=code_block_24)
clean_4 = List.Clean(list=getParameterValueByName_7)

# group: Get Dimntions
code_block_25 = CodeBlock(b=clean_3, a=code_block_23) { b+(a*2); }
code_block_26 = CodeBlock(b=clean_4, a=code_block_23) { b+(a*2); }

# group: Z Coordinate
code_block_27 = CodeBlock { "z has no if"; }
code_block_28 = CodeBlock(a=Z_3, b=code_block_26) { a-b/2; }

# group: Z Coordinate
code_block_29 = CodeBlock { "z has no if"; }
code_block_30 = CodeBlock(a=Z_3, b=code_block_26) { a+b/2; }

# group: X Coordinate
code_block_31 = CodeBlock(a=X_3, b=code_block_25) { a+b/2; a; }
if_ = RefactoredIf(test=eq, true=code_block_31.out0, false=code_block_31.a)
code_block_32 = CodeBlock { 2; }
flatten_14 = List.Flatten(list=if_, amount=code_block_32)

# group: Y Coordinate
code_block_33 = CodeBlock(a=Y_3, b=code_block_25) { a+b/2; a; }
if_2 = RefactoredIf(test=eq, true=code_block_33.a, false=code_block_33.out0)
code_block_34 = CodeBlock { 2; }
flatten_15 = List.Flatten(list=if_2, amount=code_block_34)

# group: Point 1
byCoordinates = Point.ByCoordinates(x=flatten_14, y=flatten_15, z=code_block_30)

# group: X Coordinate
code_block_35 = CodeBlock(a=X_3, b=code_block_25) { a-b/2; a; }
if_3 = RefactoredIf(test=eq, true=code_block_35.out0, false=code_block_35.a)
code_block_36 = CodeBlock { 2; }
flatten_16 = List.Flatten(list=if_3, amount=code_block_36)

# group: Y Coordinate
code_block_37 = CodeBlock(a=Y_3, b=code_block_25) { a-b/2; a; }
if_4 = RefactoredIf(test=eq, true=code_block_37.a, false=code_block_37.out0)
code_block_38 = CodeBlock { 2; }
flatten_17 = List.Flatten(list=if_4, amount=code_block_38)

# group: Point 2
byCoordinates_2 = Point.ByCoordinates(x=flatten_16, y=flatten_17, z=code_block_28)

# group: Filter
code_block_39 = CodeBlock { 0; 1; 2; }
getItemAtIndex = List.GetItemAtIndex(list=flatten_8, index=code_block_39.out0)
code_block_40 = CodeBlock { 0; 1; 2; }
getItemAtIndex_2 = List.GetItemAtIndex(list=byCoordinates, index=code_block_40.out0)
code_block_41 = CodeBlock { 0; 1; 2; }
getItemAtIndex_3 = List.GetItemAtIndex(list=byCoordinates_2, index=code_block_41.out0)
getItemAtIndex_4 = List.GetItemAtIndex(list=flatten_8, index=code_block_39.out1)
getItemAtIndex_5 = List.GetItemAtIndex(list=byCoordinates, index=code_block_40.out1)
getItemAtIndex_6 = List.GetItemAtIndex(list=byCoordinates_2, index=code_block_41.out1)
getItemAtIndex_7 = List.GetItemAtIndex(list=flatten_8, index=code_block_39.out2)
getItemAtIndex_8 = List.GetItemAtIndex(list=byCoordinates, index=code_block_40.out2)
getItemAtIndex_9 = List.GetItemAtIndex(list=byCoordinates_2, index=code_block_41.out2)

# group: Opening
flatten_18 = List.Flatten(list=getItemAtIndex_2)
flatten_19 = List.Flatten(list=getItemAtIndex_3)
wallOpenings = Python(IN[0]=getItemAtIndex, IN[1]=flatten_18, IN[2]=flatten_19)  # "Create.WallOpenings"; IronPython2
# ---------- wallOpenings.python (41 lines) ----------
import clr
import sys

clr.AddReference("RevitNodes")
import Revit
clr.ImportExtensions(Revit.Elements)
clr.ImportExtensions(Revit.GeometryConversion)
clr.AddReference("RevitServices")
import RevitServices
from RevitServices.Persistence import DocumentManager 
from RevitServices.Transactions import TransactionManager 

clr.AddReference("RevitAPI")
clr.AddReference("RevitAPIUI")

import Autodesk 
from Autodesk.Revit.DB import *
from Autodesk.Revit.UI import *

doc = DocumentManager.Instance.CurrentDBDocument
uiapp = DocumentManager.Instance.CurrentUIApplication 
app = uiapp.Application 
uidoc = uiapp.ActiveUIDocument

#######OK NOW YOU CAN CODE########
mur=UnwrapElement(IN[0])
points_list1 = IN[1]
points_list2 = IN[2]

# Ensure both lists have the same length
if len(points_list1) != len(points_list2):
    raise ValueError("Both lists of points must have the same length.")

TransactionManager.Instance.EnsureInTransaction(doc)

for pa, pb in zip(points_list1, points_list2):
    pa_xyz = pa.ToXyz()
    pb_xyz = pb.ToXyz()
    doc.Create.NewOpening(mur, pa_xyz, pb_xyz)

TransactionManager.Instance.TransactionTaskDone()
# ----------------------------------------
flatten_20 = List.Flatten(list=getItemAtIndex_5)
flatten_21 = List.Flatten(list=getItemAtIndex_6)
wallOpenings_2 = Python(IN[0]=getItemAtIndex_4, IN[1]=flatten_20, IN[2]=flatten_21)  # "Create.WallOpenings"; IronPython2; same code as wallOpenings
flatten_22 = List.Flatten(list=getItemAtIndex_8)
flatten_23 = List.Flatten(list=getItemAtIndex_9)
wallOpenings_3 = Python(IN[0]=getItemAtIndex_7, IN[1]=flatten_22, IN[2]=flatten_23)  # "Create.WallOpenings"; IronPython2; same code as wallOpenings

# group: is pipe intersect
geometry_2 = Element.Geometry(element=customISelectionFilter)
flatten_24 = List.Flatten(list=geometry_2)
doesIntersect_3 = Geometry.DoesIntersect(geometry=element_geometry_duct_2, other=geometry_2@L1)
code_block_42 = CodeBlock { 2; }
flatten_25 = List.Flatten(list=doesIntersect_3@L3, amount=code_block_42)
filterByBoolMask_6 = List.FilterByBoolMask(list=element_geometry_duct_2, mask=flatten_25@L2)
code_block_43 = CodeBlock { 2; }
flatten_26 = List.Flatten(list=filterByBoolMask_6.in@L3, amount=code_block_43)
watch_4 = Watch(flatten_26)
intersectAll_3 = Geometry.IntersectAll(geometry=flatten_24, others=watch_4@L1, lacing=CrossProduct)
code_block_44 = CodeBlock { 2; }
flatten_27 = List.Flatten(list=intersectAll_3@L3, amount=code_block_44)
centroid_3 = Solid.Centroid(solid=flatten_27)
pruneDuplicates_3 = Point.PruneDuplicates(points=centroid_3)
list_clean_4 = Custom[List Clean](list=pruneDuplicates_3)
filterByBoolMask_7 = List.FilterByBoolMask(list=flatten_2, mask=flatten_25@L2)
watch_5 = Watch(filterByBoolMask_7.in)

# group: Get The Opening
string_4 = StringInput("ID-PIPE OPENING")
byName_2 = Family.ByName(name=string_4)
types_2 = Family.Types(family=byName_2)
ꟿ_familyinstance_byhostandpoint_2 = Custom[ꟿ FamilyInstance.ByHostAndPoint](host=chop, type=types_2, point=list_clean_4)

# group: Duct Data
code_block_45 = CodeBlock { "Outside Diameter"; }
getParameterValueByName_8 = Element.GetParameterValueByName(element=watch_5, parameterName=code_block_45)
clean_5 = List.Clean(list=getParameterValueByName_8)
code_block_46 = CodeBlock { "Insulation Thickness"; }
getParameterValueByName_9 = Element.GetParameterValueByName(element=watch_5, parameterName=code_block_46)
count_3 = List.Count(list=clean_5@L2)
takeItems_3 = List.TakeItems(list=getParameterValueByName_9, amount=count_3@L1)
code_block_47 = CodeBlock { 2; }
flatten_28 = List.Flatten(list=takeItems_3@L3, amount=code_block_47)
code_block_48 = CodeBlock(a=flatten_28) { a+5; }

# group: Assign Width & Height
string_5 = StringInput("Radius")
code_block_49 = CodeBlock(b=clean_5, a=code_block_48) { (b+(a*2))/2; }
setParameterByName = Element.SetParameterByName(element=ꟿ_familyinstance_byhostandpoint_2, parameterName=string_5, value=code_block_49)
getParameterValueByName_10 = Element.GetParameterValueByName(element=setParameterByName, parameterName=string_5)

# group: Convert Curtin Wall To Solid
isEmpty_2 = List.IsEmpty(list=geometry_2@L2)
filterByBoolMask_8 = List.FilterByBoolMask(list=chop, mask=isEmpty_2)
getLocation_2 = Element.GetLocation(element=filterByBoolMask_8.in)
ZAxis_2 = Vector.ZAxis()
code_block_50 = CodeBlock { "Unconnected Height"; }
getParameterValueByName_11 = Element.GetParameterValueByName(element=filterByBoolMask_8.in, parameterName=code_block_50)
code_block_51 = CodeBlock(a=getParameterValueByName_11) { a+2000; }
extrude_2 = Curve.Extrude(curve=getLocation_2, direction=ZAxis_2, distance=code_block_51)
code_block_52 = CodeBlock { 100; }
code_block_53 = CodeBlock { true; }
thicken_2 = Surface.Thicken(surface=extrude_2, thickness=code_block_52, both_sides=code_block_53)

# group: Wall
flatten_29 = List.Flatten(list=filterByBoolMask_8.in)

# group: Test Location
endPoint_2 = Curve.EndPoint(curve=getLocation_2)
Y_4 = Point.Y(point=endPoint_2)
startPoint_2 = Curve.StartPoint(curve=getLocation_2)
Y_5 = Point.Y(point=startPoint_2)
eq_2 = Y_4 == Y_5
Z_4 = Point.Z(point=endPoint_2)
Z_5 = Point.Z(point=startPoint_2)
X_4 = Point.X(point=startPoint_2)
X_5 = Point.X(point=endPoint_2)

# group: is pipe intersect
flatten_30 = List.Flatten(list=thicken_2)
doesIntersect_4 = Geometry.DoesIntersect(geometry=element_geometry_duct_2, other=thicken_2@L1)
code_block_54 = CodeBlock { 2; }
flatten_31 = List.Flatten(list=doesIntersect_4@L3, amount=code_block_54)
filterByBoolMask_9 = List.FilterByBoolMask(list=element_geometry_duct_2, mask=flatten_31@L2)
code_block_55 = CodeBlock { 2; }
flatten_32 = List.Flatten(list=filterByBoolMask_9.in@L3, amount=code_block_55)
watch_6 = Watch(flatten_32)
intersectAll_4 = Geometry.IntersectAll(geometry=flatten_30, others=watch_6@L1, lacing=CrossProduct)
code_block_56 = CodeBlock { 2; }
flatten_33 = List.Flatten(list=intersectAll_4@L3, amount=code_block_56)
centroid_4 = Solid.Centroid(solid=flatten_33)
pruneDuplicates_4 = Point.PruneDuplicates(points=centroid_4)
list_clean_5 = Custom[List Clean](list=pruneDuplicates_4)
filterByBoolMask_10 = List.FilterByBoolMask(list=flatten_2, mask=flatten_31@L2)
code_block_57 = CodeBlock { 2; }

# group: Points
X_6 = Point.X(point=list_clean_5)
Y_6 = Point.Y(point=list_clean_5)
Z_6 = Point.Z(point=list_clean_5)

# group: Duct Data
code_block_58 = CodeBlock { "Outside Diameter"; }
getParameterValueByName_12 = Element.GetParameterValueByName(element=filterByBoolMask_10.in, parameterName=code_block_58)
clean_6 = List.Clean(list=getParameterValueByName_12)
code_block_59 = CodeBlock { "Insulation Thickness"; }
getParameterValueByName_13 = Element.GetParameterValueByName(element=filterByBoolMask_10.in, parameterName=code_block_59)
count_4 = List.Count(list=clean_6@L2)
takeItems_4 = List.TakeItems(list=getParameterValueByName_13, amount=count_4@L1)
code_block_60 = CodeBlock { 2; }
flatten_34 = List.Flatten(list=takeItems_4@L3, amount=code_block_60)
code_block_61 = CodeBlock(a=flatten_34) { a+5; }

# group: Get Dimntions
code_block_62 = CodeBlock(b=clean_6, a=code_block_61) { b+(a*2); }

# group: X Coordinate
code_block_63 = CodeBlock(a=X_6, b=code_block_62) { a+b/2; a; }
if_5 = RefactoredIf(test=eq_2, true=code_block_63.out0, false=code_block_63.a)
code_block_64 = CodeBlock { 2; }
flatten_35 = List.Flatten(list=if_5, amount=code_block_64)

# group: Y Coordinate
code_block_65 = CodeBlock(a=Y_6, b=code_block_62) { a+b/2; a; }
if_6 = RefactoredIf(test=eq_2, true=code_block_65.a, false=code_block_65.out0)
code_block_66 = CodeBlock { 2; }
flatten_36 = List.Flatten(list=if_6, amount=code_block_66)

# group: Z Coordinate
code_block_67 = CodeBlock(a=Z_6, b=code_block_62) { a+b/2; }
code_block_68 = CodeBlock { "z has no if"; }

# group: Point 1
byCoordinates_3 = Point.ByCoordinates(x=flatten_35, y=flatten_36, z=code_block_67)

# group: X Coordinate
code_block_69 = CodeBlock(a=X_6, b=code_block_62) { a-b/2; a; }
if_7 = RefactoredIf(test=eq_2, true=code_block_69.out0, false=code_block_69.a)
code_block_70 = CodeBlock { 2; }
flatten_37 = List.Flatten(list=if_7, amount=code_block_70)

# group: Y Coordinate
code_block_71 = CodeBlock(a=Y_6, b=code_block_62) { a-b/2; a; }
if_8 = RefactoredIf(test=eq_2, true=code_block_71.a, false=code_block_71.out0)
code_block_72 = CodeBlock { 2; }
flatten_38 = List.Flatten(list=if_8, amount=code_block_72)

# group: Z Coordinate
code_block_73 = CodeBlock(a=Z_6, b=code_block_62) { a-b/2; }
code_block_74 = CodeBlock { "z has no if"; }

# group: Point 2
byCoordinates_4 = Point.ByCoordinates(x=flatten_37, y=flatten_38, z=code_block_73)

# group: Filter
code_block_75 = CodeBlock { 0; 1; 2; }
getItemAtIndex_10 = List.GetItemAtIndex(list=flatten_29, index=code_block_75.out2)
code_block_76 = CodeBlock { 0; 1; 2; }
getItemAtIndex_11 = List.GetItemAtIndex(list=byCoordinates_3, index=code_block_76.out2)
code_block_77 = CodeBlock { 0; 1; 2; }
getItemAtIndex_12 = List.GetItemAtIndex(list=byCoordinates_4, index=code_block_77.out2)
getItemAtIndex_13 = List.GetItemAtIndex(list=flatten_29, index=code_block_75.out1)
getItemAtIndex_14 = List.GetItemAtIndex(list=byCoordinates_3, index=code_block_76.out1)
getItemAtIndex_15 = List.GetItemAtIndex(list=byCoordinates_4, index=code_block_77.out1)
getItemAtIndex_16 = List.GetItemAtIndex(list=flatten_29, index=code_block_75.out0)
getItemAtIndex_17 = List.GetItemAtIndex(list=byCoordinates_3, index=code_block_76.out0)
getItemAtIndex_18 = List.GetItemAtIndex(list=byCoordinates_4, index=code_block_77.out0)

# group: Opening
flatten_39 = List.Flatten(list=getItemAtIndex_11)
flatten_40 = List.Flatten(list=getItemAtIndex_12)
wallOpenings_4 = Python(IN[0]=getItemAtIndex_10, IN[1]=flatten_39, IN[2]=flatten_40)  # "Create.WallOpenings"; IronPython2; same code as wallOpenings
flatten_41 = List.Flatten(list=getItemAtIndex_14)
flatten_42 = List.Flatten(list=getItemAtIndex_15)
wallOpenings_5 = Python(IN[0]=getItemAtIndex_13, IN[1]=flatten_41, IN[2]=flatten_42)  # "Create.WallOpenings"; IronPython2; same code as wallOpenings
flatten_43 = List.Flatten(list=getItemAtIndex_17)
flatten_44 = List.Flatten(list=getItemAtIndex_18)
wallOpenings_6 = Python(IN[0]=getItemAtIndex_16, IN[1]=flatten_43, IN[2]=flatten_44)  # "Create.WallOpenings"; IronPython2; same code as wallOpenings
