# Dynamo graph Opening Genrator V 1.45.dyn (Dynamo 2.12.1.8246)
# packages: Rhythm 2023.9.1, bimorphNodes 4.2.4, spring nodes 210.1.1, Genius Loci 2023.1.23

# group: Walls
categories = Categories("OST_Walls")
all_elements_of_category = ElementsOfCategory(Category=categories)
getLocation = Element.GetLocation(element=all_elements_of_category)
string_from_object = FromObject(object=getLocation)
code_block = CodeBlock { 0; 4; }
substring = String.Substring(string=string_from_object, startIndex=code_block.out0, length=code_block.out1)
code_block_2 = CodeBlock { "Line"; }
eq = substring == code_block_2
filterByBoolMask = List.FilterByBoolMask(list=all_elements_of_category, mask=eq)
getLocation_2 = Element.GetLocation(element=filterByBoolMask.in)

# group: Test Location
endPoint = Curve.EndPoint(curve=getLocation_2)
X = Point.X(point=endPoint)
Z = Point.Z(point=endPoint)
startPoint = Curve.StartPoint(curve=getLocation_2)
Z_2 = Point.Z(point=startPoint)
X_2 = Point.X(point=startPoint)
Y = Point.Y(point=endPoint)
Y_2 = Point.Y(point=startPoint)
eq_2 = Y == Y_2
filterByBoolMask_2 = List.FilterByBoolMask(list=filterByBoolMask.in, mask=eq_2)

# group: DUCT CATEGORY
categories_2 = Categories("OST_RvtLinks")
all_elements_of_category_2 = ElementsOfCategory(Category=categories_2)
categories_3 = Categories("OST_DuctCurves")
ofCategory = Revit.LinkElement.OfCategory(linkInstance=all_elements_of_category_2, category=categories_3)
flatten = List.Flatten(list=ofCategory)

# group: Remove Evil
name = Element.Name(element=flatten)
code_block_3 = CodeBlock(a=name) { a=="Default"; }
filterByBoolMask_3 = List.FilterByBoolMask(list=flatten, mask=code_block_3)
code_block_4 = CodeBlock(a=name) { a=="Standerd"; }
filterByBoolMask_4 = List.FilterByBoolMask(list=flatten, mask=code_block_4)

# group (continued): DUCT CATEGORY
element_geometry_duct = Element.Geometry(element=filterByBoolMask_3.in)
flatten_2 = List.Flatten(list=element_geometry_duct)

# group: Seprate Walls X
geometry = Element.Geometry(element=filterByBoolMask_2.in)
isEmpty = List.IsEmpty(list=geometry@L2)
filterByBoolMask_5 = List.FilterByBoolMask(list=filterByBoolMask_2.in, mask=isEmpty)

# group: Curtin Wall X
flatten_3 = List.Flatten(list=filterByBoolMask_5.in)
getLocation_3 = Element.GetLocation(element=flatten_3)
ZAxis = Vector.ZAxis()
code_block_5 = CodeBlock { "Unconnected Height"; }
getParameterValueByName = Element.GetParameterValueByName(element=flatten_3, parameterName=code_block_5)
code_block_6 = CodeBlock(a=getParameterValueByName) { a+2000; }
extrude = Curve.Extrude(curve=getLocation_3, direction=ZAxis, distance=code_block_6)
code_block_7 = CodeBlock { 26; }
code_block_8 = CodeBlock { true; }
thicken = Surface.Thicken(surface=extrude, thickness=code_block_7, both_sides=code_block_8)

# group: X Curtain
list_create = List.Create(item0=flatten_3)
flatten_4 = List.Flatten(list=list_create)
list_create_2 = List.Create(item0=thicken)
flatten_5 = List.Flatten(list=list_create_2)

# group: PIPE CATEGORY
categories_4 = Categories("OST_RvtLinks")
all_elements_of_category_3 = ElementsOfCategory(Category=categories_4)
categories_5 = Categories("OST_PipeCurves")
ofCategory_2 = Revit.LinkElement.OfCategory(linkInstance=all_elements_of_category_3, category=categories_5)
flatten_6 = List.Flatten(list=ofCategory_2)
element_geometry_pipe = Element.Geometry(element=flatten_6)
flatten_7 = List.Flatten(list=element_geometry_pipe)

# group: Wall Voids
list_create_3 = List.Create(item0=flatten_7)
flatten_8 = List.Flatten(list=list_create_3)
list_clean = Custom[List Clean](list=flatten_8)  # package Genius Loci; Removes all Null, Empty and Blank from a list or nested list of lists.

# group: Links
list_create_4 = List.Create(item0=flatten_6)
flatten_9 = List.Flatten(list=list_create_4)
list_clean_2 = Custom[List Clean](list=flatten_9)

# group: X , Y Glitch Electrical Fixtures
doesIntersect = Geometry.DoesIntersect(geometry=list_clean, other=flatten_5@L1)
anyTrue = List.AnyTrue(list=doesIntersect@L2)
filterByBoolMask_6 = List.FilterByBoolMask(list=flatten_4, mask=anyTrue)
code_block_9 = CodeBlock { 1; }
doesIntersect_2 = Geometry.DoesIntersect(geometry=list_clean, other=flatten_5@L1)
anyTrue_2 = List.AnyTrue(list=doesIntersect_2@L2)
filterByBoolMask_7 = List.FilterByBoolMask(list=flatten_5, mask=anyTrue_2)
doesIntersect_3 = Geometry.DoesIntersect(geometry=list_clean, other=filterByBoolMask_7.in@L1)
filterByBoolMask_8 = List.FilterByBoolMask(list=list_clean, mask=doesIntersect_3@L2)
code_block_10 = CodeBlock { 3; }
filterByBoolMask_9 = List.FilterByBoolMask(list=list_clean_2, mask=doesIntersect_3@L2)
code_block_11 = CodeBlock { 3; }

# group: Data
element = List.Chop(list=filterByBoolMask_6.in, lengths=code_block_9)  # "Wall.Element"
solid = List.Chop(list=filterByBoolMask_7.in, lengths=code_block_9)  # "Wall.Solid"
solid_2 = List.Flatten(list=filterByBoolMask_8.in@L2, amount=code_block_10)  # "Duct.Solid"
element_2 = List.Flatten(list=filterByBoolMask_9.in@L2, amount=code_block_11)  # "Duct.Element"

# group: Wall
flatten_10 = List.Flatten(list=element)

# group: join
intersectAll = Geometry.IntersectAll(geometry=solid, others=solid_2@L1, lacing=CrossProduct)
code_block_12 = CodeBlock { 4; }
flatten_11 = List.Flatten(list=intersectAll@L4, amount=code_block_12)

# group: Points & Solids
centroid = Solid.Centroid(solid=flatten_11)
pruneDuplicates = Point.PruneDuplicates(points=centroid)
geometry_2 = Element.Geometry(element=element_2)
code_block_13 = CodeBlock { 2; }
flatten_12 = List.Flatten(list=geometry_2@L3, amount=code_block_13)

# group: List Order
X_3 = Point.X(point=pruneDuplicates)
sortIndexByValue = List.SortIndexByValue(list=X_3)
reorder = List.Reorder(list=pruneDuplicates@L2, indices=sortIndexByValue@L2)
centroid_2 = Solid.Centroid(solid=flatten_12)
X_4 = Point.X(point=centroid_2)
sortIndexByValue_2 = List.SortIndexByValue(list=X_4)
reorder_2 = List.Reorder(list=element_2@L2, indices=sortIndexByValue_2@L2)

# group: Points
X_5 = Point.X(point=reorder)
Y_3 = Point.Y(point=reorder)
Z_3 = Point.Z(point=reorder)

# group: Gide
string_from_object_2 = FromObject(object=reorder_2)
code_block_14 = CodeBlock(a=string_from_object_2) { a =="LinkElement(Pipe)"; }
code_block_15 = CodeBlock { "Insulation Thickness"; }
getParameterValueByName_2 = Element.GetParameterValueByName(element=reorder_2, parameterName=code_block_15)

# group: Duct Data
code_block_16 = CodeBlock { "Outside Diameter"; }
code_block_17 = CodeBlock { "Width"; }
if_ = RefactoredIf(test=code_block_14, true=code_block_16, false=code_block_17)
getParameterValueByName_3 = Element.GetParameterValueByName(element=reorder_2, parameterName=if_)
list_clean_3 = Custom[List Clean](list=getParameterValueByName_3)
code_block_18 = CodeBlock { 5; 20; }
if_2 = RefactoredIf(test=code_block_14, true=code_block_18.out0, false=code_block_18.out1)
code_block_19 = CodeBlock(a=getParameterValueByName_2, z=if_2) { a+z; }
code_block_20 = CodeBlock { "Height"; }
if_3 = RefactoredIf(test=code_block_14, true=code_block_16, false=code_block_20)
getParameterValueByName_4 = Element.GetParameterValueByName(element=reorder_2, parameterName=if_3)
list_clean_4 = Custom[List Clean](list=getParameterValueByName_4)

# group: Get Dimntions
code_block_21 = CodeBlock(w=list_clean_3, a=code_block_19) { w+(a*2); }
code_block_22 = CodeBlock(h=list_clean_4, a=code_block_19) { h+(a*2); }

# group: X Coordinate
code_block_23 = CodeBlock(x=X_5, w=code_block_21) { x+w/2; x; }
code_block_24 = CodeBlock { 1; }
flatten_13 = List.Flatten(list=code_block_23.out0@L2, amount=code_block_24)

# group: Y Coordinate
code_block_25 = CodeBlock(y=Y_3) { y; }
code_block_26 = CodeBlock { 1; }
flatten_14 = List.Flatten(list=code_block_25@L2, amount=code_block_26)

# group: Z Coordinate
code_block_27 = CodeBlock(z=Z_3, h=code_block_22) { z+h/2; h; }
code_block_28 = CodeBlock { "z has no if"; }

# group: Point 1
byCoordinates = Point.ByCoordinates(x=flatten_13, y=flatten_14, z=code_block_27.out0)

# group: X Coordinate
code_block_29 = CodeBlock(x=X_5, w=code_block_21) { x-w/2; x; }
code_block_30 = CodeBlock { 1; }
flatten_15 = List.Flatten(list=code_block_29.out0@L2, amount=code_block_30)

# group: Y Coordinate
code_block_31 = CodeBlock(y=Y_3) { y; }
code_block_32 = CodeBlock { 1; }
flatten_16 = List.Flatten(list=code_block_31@L2, amount=code_block_32)

# group: Z Coordinate
code_block_33 = CodeBlock(z=Z_3, h=code_block_22) { z-h/2; h; }
code_block_34 = CodeBlock { "z has no if"; }

# group: Point 2
byCoordinates_2 = Point.ByCoordinates(x=flatten_15, y=flatten_16, z=code_block_33.out0)

# group: Opening Wall
wall = Hood.Opening.Wall(wall=flatten_10, point1=byCoordinates, point2=byCoordinates_2)

# group: Walls X
flatten_17 = List.Flatten(list=filterByBoolMask_5.out)
getLocation_4 = Element.GetLocation(element=flatten_17)
ZAxis_2 = Vector.ZAxis()
code_block_35 = CodeBlock { "Unconnected Height"; }
getParameterValueByName_5 = Element.GetParameterValueByName(element=flatten_17, parameterName=code_block_35)
code_block_36 = CodeBlock(a=getParameterValueByName_5) { a+2000; }
extrude_2 = Curve.Extrude(curve=getLocation_4, direction=ZAxis_2, distance=code_block_36)
code_block_37 = CodeBlock { "Width"; }
ʳʰʸᵗʰᵐ_elements = Rhythm.Revit.Elements.Elements.GetParameterValueByNameTypeOrInstance(element=flatten_17, parameterName=code_block_37)
code_block_38 = CodeBlock { true; }
thicken_2 = Surface.Thicken(surface=extrude_2, thickness=ʳʰʸᵗʰᵐ_elements, both_sides=code_block_38)

# group: X Wall
walls = List.Create(item0=flatten_17)
flatten_18 = List.Flatten(list=walls)
solids = List.Create(item0=thicken_2)
flatten_19 = List.Flatten(list=solids)

# group: X , Y Glitch Electrical Fixtures
doesIntersect_4 = Geometry.DoesIntersect(geometry=list_clean, other=flatten_19@L1)
anyTrue_3 = List.AnyTrue(list=doesIntersect_4@L2)
filterByBoolMask_10 = List.FilterByBoolMask(list=flatten_18, mask=anyTrue_3)
code_block_39 = CodeBlock { 1; }
doesIntersect_5 = Geometry.DoesIntersect(geometry=list_clean, other=flatten_19@L1)
anyTrue_4 = List.AnyTrue(list=doesIntersect_5@L2)
filterByBoolMask_11 = List.FilterByBoolMask(list=flatten_19, mask=anyTrue_4)
doesIntersect_6 = Geometry.DoesIntersect(geometry=list_clean, other=filterByBoolMask_11.in@L1)
filterByBoolMask_12 = List.FilterByBoolMask(list=list_clean_2, mask=doesIntersect_6@L2)
code_block_40 = CodeBlock { 3; }
filterByBoolMask_13 = List.FilterByBoolMask(list=list_clean, mask=doesIntersect_6@L2)
code_block_41 = CodeBlock { 3; }

# group: Data
element_3 = List.Chop(list=filterByBoolMask_10.in, lengths=code_block_39)  # "Wall.Element"
element_4 = List.Flatten(list=filterByBoolMask_12.in@L2, amount=code_block_40)  # "Duct.Element"
solid_3 = List.Chop(list=filterByBoolMask_11.in, lengths=code_block_39)  # "Wall.Solid"
solid_4 = List.Flatten(list=filterByBoolMask_13.in@L2, amount=code_block_41)  # "Duct.Solid"

# group: join
intersectAll_2 = Geometry.IntersectAll(geometry=solid_3, others=solid_4@L1, lacing=CrossProduct)
code_block_42 = CodeBlock { 4; }
flatten_20 = List.Flatten(list=intersectAll_2@L4, amount=code_block_42)

# group: Points & Solids
geometry_3 = Element.Geometry(element=element_4)
code_block_43 = CodeBlock { 2; }
flatten_21 = List.Flatten(list=geometry_3@L3, amount=code_block_43)
centroid_3 = Solid.Centroid(solid=flatten_20)
pruneDuplicates_2 = Point.PruneDuplicates(points=centroid_3)

# group: List Order
centroid_4 = Solid.Centroid(solid=flatten_21)
X_6 = Point.X(point=centroid_4)
sortIndexByValue_3 = List.SortIndexByValue(list=X_6)
reorder_3 = List.Reorder(list=element_4@L2, indices=sortIndexByValue_3@L2)
X_7 = Point.X(point=pruneDuplicates_2)
sortIndexByValue_4 = List.SortIndexByValue(list=X_7)
reorder_4 = List.Reorder(list=pruneDuplicates_2@L2, indices=sortIndexByValue_4@L2)

# group: Gide
string_from_object_3 = FromObject(object=reorder_3)
code_block_44 = CodeBlock(a=string_from_object_3) { a =="LinkElement(Pipe)"; }
code_block_45 = CodeBlock { "Insulation Thickness"; }
getParameterValueByName_6 = Element.GetParameterValueByName(element=reorder_3, parameterName=code_block_45)

# group: If
string = StringInput("ID-PIPE OPENING")
string_2 = StringInput("ID-DUCT OPENING")
if_4 = RefactoredIf(test=code_block_44, true=string, false=string_2)

# group: Get The Opening
byName = Family.ByName(name=if_4)
types = Family.Types(family=byName)
code_block_46 = CodeBlock { 1; }
flatten_22 = List.Flatten(list=types@L3, amount=code_block_46)
ꟿ_familyinstance_byhostandpoint = Custom[ꟿ FamilyInstance.ByHostAndPoint](host=element_3, type=flatten_22, point=reorder_4)  # package spring nodes; Creates hosted family instances(doors/windows) at the specified points. You can feed either a single family type or a unique type for each instance.

# group: If
string_3 = StringInput("Diameter")
string_4 = StringInput("Width")
if_5 = RefactoredIf(test=code_block_44, true=string_3, false=string_4)

# group: Duct Data
code_block_47 = CodeBlock { "Outside Diameter"; }
code_block_48 = CodeBlock { "Width"; }
if_6 = RefactoredIf(test=code_block_44, true=code_block_47, false=code_block_48)
getParameterValueByName_7 = Element.GetParameterValueByName(element=reorder_3, parameterName=if_6)
list_clean_5 = Custom[List Clean](list=getParameterValueByName_7)
code_block_49 = CodeBlock { 5; 20; }
if_7 = RefactoredIf(test=code_block_44, true=code_block_49.out0, false=code_block_49.out1)
code_block_50 = CodeBlock(a=getParameterValueByName_6, z=if_7) { a+z; }
code_block_51 = CodeBlock { "Height"; }
if_8 = RefactoredIf(test=code_block_44, true=code_block_47, false=code_block_51)
getParameterValueByName_8 = Element.GetParameterValueByName(element=reorder_3, parameterName=if_8)
list_clean_6 = Custom[List Clean](list=getParameterValueByName_8)

# group: Get Dimntions
code_block_52 = CodeBlock(w=list_clean_5, a=code_block_50) { w+(a*2); }
code_block_53 = CodeBlock(h=list_clean_6, a=code_block_50) { h+(a*2); }

# group: If
string_5 = StringInput("Diameter")
string_6 = StringInput("Height")
if_9 = RefactoredIf(test=code_block_44, true=string_5, false=string_6)

# group: Assign Width & Height
ʳʰʸᵗʰᵐ_elements_2 = Rhythm.Revit.Elements.Elements.SetParameterByNameTypeOrInstance(element=ꟿ_familyinstance_byhostandpoint, parameterName=if_5, value=code_block_52, lacing=Longest)
ʳʰʸᵗʰᵐ_elements_3 = Rhythm.Revit.Elements.Elements.SetParameterByNameTypeOrInstance(element=ꟿ_familyinstance_byhostandpoint, parameterName=if_9, value=code_block_53, lacing=Longest)

# group: Seprate Walls Y
geometry_4 = Element.Geometry(element=filterByBoolMask_2.out)
isEmpty_2 = List.IsEmpty(list=geometry_4@L2)
filterByBoolMask_14 = List.FilterByBoolMask(list=filterByBoolMask_2.out, mask=isEmpty_2)

# group: Curtin Wall Y
flatten_23 = List.Flatten(list=filterByBoolMask_14.in)
getLocation_5 = Element.GetLocation(element=flatten_23)
ZAxis_3 = Vector.ZAxis()
code_block_54 = CodeBlock { "Unconnected Height"; }
getParameterValueByName_9 = Element.GetParameterValueByName(element=flatten_23, parameterName=code_block_54)
code_block_55 = CodeBlock(a=getParameterValueByName_9) { a+2000; }
extrude_3 = Curve.Extrude(curve=getLocation_5, direction=ZAxis_3, distance=code_block_55)
code_block_56 = CodeBlock { 26; }
code_block_57 = CodeBlock { true; }
thicken_3 = Surface.Thicken(surface=extrude_3, thickness=code_block_56, both_sides=code_block_57)

# group: Y Curtain
list_create_5 = List.Create(item0=flatten_23)
flatten_24 = List.Flatten(list=list_create_5)
list_create_6 = List.Create(item0=thicken_3)
flatten_25 = List.Flatten(list=list_create_6)

# group: X , Y Glitch Electrical Fixtures
doesIntersect_7 = Geometry.DoesIntersect(geometry=list_clean, other=flatten_25@L1)
anyTrue_5 = List.AnyTrue(list=doesIntersect_7@L2)
filterByBoolMask_15 = List.FilterByBoolMask(list=flatten_24, mask=anyTrue_5)
code_block_58 = CodeBlock { 1; }
doesIntersect_8 = Geometry.DoesIntersect(geometry=list_clean, other=flatten_25@L1)
anyTrue_6 = List.AnyTrue(list=doesIntersect_8@L2)
filterByBoolMask_16 = List.FilterByBoolMask(list=flatten_25, mask=anyTrue_6)
doesIntersect_9 = Geometry.DoesIntersect(geometry=list_clean, other=filterByBoolMask_16.in@L1)
filterByBoolMask_17 = List.FilterByBoolMask(list=list_clean, mask=doesIntersect_9@L2)
code_block_59 = CodeBlock { 3; }
filterByBoolMask_18 = List.FilterByBoolMask(list=list_clean_2, mask=doesIntersect_9@L2)
code_block_60 = CodeBlock { 3; }

# group: Data
element_5 = List.Chop(list=filterByBoolMask_15.in, lengths=code_block_58)  # "Wall.Element"
solid_5 = List.Chop(list=filterByBoolMask_16.in, lengths=code_block_58)  # "Wall.Solid"
solid_6 = List.Flatten(list=filterByBoolMask_17.in@L2, amount=code_block_59)  # "Duct.Solid"
element_6 = List.Flatten(list=filterByBoolMask_18.in@L2, amount=code_block_60)  # "Duct.Element"

# group: Wall
flatten_26 = List.Flatten(list=element_5)

# group: join
intersectAll_3 = Geometry.IntersectAll(geometry=solid_5, others=solid_6@L1, lacing=CrossProduct)
code_block_61 = CodeBlock { 4; }
flatten_27 = List.Flatten(list=intersectAll_3@L4, amount=code_block_61)

# group: Points & Solids
centroid_5 = Solid.Centroid(solid=flatten_27)
pruneDuplicates_3 = Point.PruneDuplicates(points=centroid_5)
geometry_5 = Element.Geometry(element=element_6)
code_block_62 = CodeBlock { 2; }
flatten_28 = List.Flatten(list=geometry_5@L3, amount=code_block_62)

Y_4 = Point.Y(point=pruneDuplicates_3)

# group: List Order
sortIndexByValue_5 = List.SortIndexByValue(list=Y_4)
reorder_5 = List.Reorder(list=pruneDuplicates_3@L2, indices=sortIndexByValue_5@L2)
centroid_6 = Solid.Centroid(solid=flatten_28)
Y_5 = Point.Y(point=centroid_6)
sortIndexByValue_6 = List.SortIndexByValue(list=Y_5)
reorder_6 = List.Reorder(list=element_6@L2, indices=sortIndexByValue_6@L2)

# group: Points
X_8 = Point.X(point=reorder_5)
Y_6 = Point.Y(point=reorder_5)
Z_4 = Point.Z(point=reorder_5)

# group: X Coordinate
code_block_63 = CodeBlock(x=X_8) { x; }
code_block_64 = CodeBlock { 1; }
flatten_29 = List.Flatten(list=code_block_63@L2, amount=code_block_64)

# group: Gide
string_from_object_4 = FromObject(object=reorder_6)
code_block_65 = CodeBlock(a=string_from_object_4) { a =="LinkElement(Pipe)"; }
code_block_66 = CodeBlock { "Insulation Thickness"; }
getParameterValueByName_10 = Element.GetParameterValueByName(element=reorder_6, parameterName=code_block_66)

# group: Duct Data
code_block_67 = CodeBlock { "Outside Diameter"; }
code_block_68 = CodeBlock { "Width"; }
if_10 = RefactoredIf(test=code_block_65, true=code_block_67, false=code_block_68)
getParameterValueByName_11 = Element.GetParameterValueByName(element=reorder_6, parameterName=if_10)
list_clean_7 = Custom[List Clean](list=getParameterValueByName_11)
code_block_69 = CodeBlock { 5; 20; }
if_11 = RefactoredIf(test=code_block_65, true=code_block_69.out0, false=code_block_69.out1)
code_block_70 = CodeBlock(a=getParameterValueByName_10, z=if_11) { a+z; }
code_block_71 = CodeBlock { "Height"; }
if_12 = RefactoredIf(test=code_block_65, true=code_block_67, false=code_block_71)
getParameterValueByName_12 = Element.GetParameterValueByName(element=reorder_6, parameterName=if_12)
list_clean_8 = Custom[List Clean](list=getParameterValueByName_12)

# group: Get Dimntions
code_block_72 = CodeBlock(w=list_clean_7, a=code_block_70) { w+(a*2); }
code_block_73 = CodeBlock(h=list_clean_8, a=code_block_70) { h+(a*2); }

# group: Z Coordinate
code_block_74 = CodeBlock { "z has no if"; }
code_block_75 = CodeBlock(z=Z_4, h=code_block_73) { z-h/2; h; }

# group: Y Coordinate
code_block_76 = CodeBlock(y=Y_6, l=code_block_72) { y+l/2; y; }
code_block_77 = CodeBlock { 1; }
flatten_30 = List.Flatten(list=code_block_76.out0@L2, amount=code_block_77)

# group: Z Coordinate
code_block_78 = CodeBlock(z=Z_4, h=code_block_73) { z+h/2; h; }
code_block_79 = CodeBlock { "z has no if"; }

# group: Point 1
byCoordinates_3 = Point.ByCoordinates(x=flatten_29, y=flatten_30, z=code_block_78.out0)

# group: X Coordinate
code_block_80 = CodeBlock(x=X_8) { x; }
code_block_81 = CodeBlock { 1; }
flatten_31 = List.Flatten(list=code_block_80@L2, amount=code_block_81)

# group: Y Coordinate
code_block_82 = CodeBlock(y=Y_6, l=code_block_72) { y-l/2; y; }
code_block_83 = CodeBlock { 1; }
flatten_32 = List.Flatten(list=code_block_82.out0@L2, amount=code_block_83)

# group: Point 2
byCoordinates_4 = Point.ByCoordinates(x=flatten_31, y=flatten_32, z=code_block_75.out0)

# group: Opening Wall
wall_2 = Hood.Opening.Wall(wall=flatten_26, point1=byCoordinates_3, point2=byCoordinates_4)

# group: Walls Y
flatten_33 = List.Flatten(list=filterByBoolMask_14.out)
getLocation_6 = Element.GetLocation(element=flatten_33)
ZAxis_4 = Vector.ZAxis()
code_block_84 = CodeBlock { "Unconnected Height"; }
getParameterValueByName_13 = Element.GetParameterValueByName(element=flatten_33, parameterName=code_block_84)
code_block_85 = CodeBlock(a=getParameterValueByName_13) { a+2000; }
extrude_4 = Curve.Extrude(curve=getLocation_6, direction=ZAxis_4, distance=code_block_85)
code_block_86 = CodeBlock { "Width"; }
ʳʰʸᵗʰᵐ_elements_4 = Rhythm.Revit.Elements.Elements.GetParameterValueByNameTypeOrInstance(element=flatten_33, parameterName=code_block_86)
code_block_87 = CodeBlock { true; }
thicken_4 = Surface.Thicken(surface=extrude_4, thickness=ʳʰʸᵗʰᵐ_elements_4, both_sides=code_block_87)

# group: Y Wall
walls_2 = List.Create(item0=flatten_33)
flatten_34 = List.Flatten(list=walls_2)
solids_2 = List.Create(item0=thicken_4)
flatten_35 = List.Flatten(list=solids_2)

# group: X , Y Glitch Electrical Fixtures
doesIntersect_10 = Geometry.DoesIntersect(geometry=list_clean, other=flatten_35@L1)
anyTrue_7 = List.AnyTrue(list=doesIntersect_10@L2)
filterByBoolMask_19 = List.FilterByBoolMask(list=flatten_34, mask=anyTrue_7)
code_block_88 = CodeBlock { 1; }
doesIntersect_11 = Geometry.DoesIntersect(geometry=list_clean, other=flatten_35@L1)
anyTrue_8 = List.AnyTrue(list=doesIntersect_11@L2)
filterByBoolMask_20 = List.FilterByBoolMask(list=flatten_35, mask=anyTrue_8)
doesIntersect_12 = Geometry.DoesIntersect(geometry=list_clean, other=filterByBoolMask_20.in@L1)
filterByBoolMask_21 = List.FilterByBoolMask(list=list_clean_2, mask=doesIntersect_12@L2)
code_block_89 = CodeBlock { 3; }
filterByBoolMask_22 = List.FilterByBoolMask(list=list_clean, mask=doesIntersect_12@L2)
code_block_90 = CodeBlock { 3; }

# group: Data
element_7 = List.Chop(list=filterByBoolMask_19.in, lengths=code_block_88)  # "Wall.Element"
element_8 = List.Flatten(list=filterByBoolMask_21.in@L2, amount=code_block_89)  # "Duct.Element"
solid_7 = List.Chop(list=filterByBoolMask_20.in, lengths=code_block_88)  # "Wall.Solid"
solid_8 = List.Flatten(list=filterByBoolMask_22.in@L2, amount=code_block_90)  # "Duct.Solid"

# group: join
intersectAll_4 = Geometry.IntersectAll(geometry=solid_7, others=solid_8@L1, lacing=CrossProduct)
code_block_91 = CodeBlock { 4; }
flatten_36 = List.Flatten(list=intersectAll_4@L4, amount=code_block_91)

# group: Points & Solids
geometry_6 = Element.Geometry(element=element_8)
code_block_92 = CodeBlock { 2; }
flatten_37 = List.Flatten(list=geometry_6@L3, amount=code_block_92)
centroid_7 = Solid.Centroid(solid=flatten_36)
pruneDuplicates_4 = Point.PruneDuplicates(points=centroid_7)

# group: List Order
centroid_8 = Solid.Centroid(solid=flatten_37)
Y_7 = Point.Y(point=centroid_8)
sortIndexByValue_7 = List.SortIndexByValue(list=Y_7)
reorder_7 = List.Reorder(list=element_8@L2, indices=sortIndexByValue_7@L2)
Y_8 = Point.Y(point=pruneDuplicates_4)
sortIndexByValue_8 = List.SortIndexByValue(list=Y_8)
reorder_8 = List.Reorder(list=pruneDuplicates_4@L2, indices=sortIndexByValue_8@L2)

# group: Gide
string_from_object_5 = FromObject(object=reorder_7)
code_block_93 = CodeBlock(a=string_from_object_5) { a =="LinkElement(Pipe)"; }
code_block_94 = CodeBlock { "Insulation Thickness"; }
getParameterValueByName_14 = Element.GetParameterValueByName(element=reorder_7, parameterName=code_block_94)

# group: If
string_7 = StringInput("ID-PIPE OPENING")
string_8 = StringInput("ID-DUCT OPENING")
if_13 = RefactoredIf(test=code_block_93, true=string_7, false=string_8)

# group: Get The Opening
byName_2 = Family.ByName(name=if_13)
types_2 = Family.Types(family=byName_2)
code_block_95 = CodeBlock { 1; }
flatten_38 = List.Flatten(list=types_2@L3, amount=code_block_95)
ꟿ_familyinstance_byhostandpoint_2 = Custom[ꟿ FamilyInstance.ByHostAndPoint](host=element_7, type=flatten_38, point=reorder_8)

# group: If
string_9 = StringInput("Diameter")
string_10 = StringInput("Height")
if_14 = RefactoredIf(test=code_block_93, true=string_9, false=string_10)

# group: Duct Data
code_block_96 = CodeBlock { "Outside Diameter"; }
code_block_97 = CodeBlock { "Height"; }
if_15 = RefactoredIf(test=code_block_93, true=code_block_96, false=code_block_97)
getParameterValueByName_15 = Element.GetParameterValueByName(element=reorder_7, parameterName=if_15)
list_clean_9 = Custom[List Clean](list=getParameterValueByName_15)
code_block_98 = CodeBlock { 5; 20; }
if_16 = RefactoredIf(test=code_block_93, true=code_block_98.out0, false=code_block_98.out1)
code_block_99 = CodeBlock(a=getParameterValueByName_14, z=if_16) { a+z; }
code_block_100 = CodeBlock { "Width"; }
if_17 = RefactoredIf(test=code_block_93, true=code_block_96, false=code_block_100)
getParameterValueByName_16 = Element.GetParameterValueByName(element=reorder_7, parameterName=if_17)
list_clean_10 = Custom[List Clean](list=getParameterValueByName_16)

# group: Get Dimntions
code_block_101 = CodeBlock(h=list_clean_9, a=code_block_99) { h+(a*2); }
code_block_102 = CodeBlock(w=list_clean_10, a=code_block_99) { w+(a*2); }

# group: If
string_11 = StringInput("Diameter")
string_12 = StringInput("Width")
if_18 = RefactoredIf(test=code_block_93, true=string_11, false=string_12)

# group: Assign Width & Height
ʳʰʸᵗʰᵐ_elements_5 = Rhythm.Revit.Elements.Elements.SetParameterByNameTypeOrInstance(element=ꟿ_familyinstance_byhostandpoint_2, parameterName=if_14, value=code_block_101, lacing=Longest)
ʳʰʸᵗʰᵐ_elements_6 = Rhythm.Revit.Elements.Elements.SetParameterByNameTypeOrInstance(element=ꟿ_familyinstance_byhostandpoint_2, parameterName=if_18, value=code_block_102, lacing=Longest)
