# Dynamo graph 0.dyn "1" (Dynamo 2.12.1.8246)

select_model_element = DSModelElementSelection()  # 1 picked in the model; graph input

# group: Kaboria
getLocation = Element.GetLocation(element=select_model_element)
code_block = CodeBlock { 1/2; }
pointAtParameter = Curve.PointAtParameter(curve=getLocation, param=code_block)
code_block_2 = CodeBlock { 1400; }
translate = Geometry.Translate(geometry=pointAtParameter, zTranslation=code_block_2)

# group: Test Location
endPoint = Curve.EndPoint(curve=getLocation)
Y = Point.Y(point=endPoint)
startPoint = Curve.StartPoint(curve=getLocation)
Y_2 = Point.Y(point=startPoint)
eq = Y == Y_2
X = Point.X(point=endPoint)
Z = Point.Z(point=endPoint)
Z_2 = Point.Z(point=startPoint)
X_2 = Point.X(point=startPoint)

code_block_3 = CodeBlock { 2500; }
translate_2 = Geometry.Translate(geometry=pointAtParameter, zTranslation=code_block_3)
list_create = List.Create(item0=translate, item1=translate_2)

# group (continued): Kaboria
X_3 = Point.X(point=list_create)
Y_3 = Point.Y(point=list_create)
Z_3 = Point.Z(point=list_create)

# group: Paramter Kaboria
width = CodeBlock { 1400; }
height = CodeBlock { 800; }

# group: X Coordinate
code_block_4 = CodeBlock(a=X_3, b=width) { a+b/2; a; }
if_ = RefactoredIf(test=eq, true=code_block_4.out0, false=code_block_4.a)

# group: Y Coordinate
code_block_5 = CodeBlock(a=Y_3, b=width) { a+b/2; a; }
if_2 = RefactoredIf(test=eq, true=code_block_5.a, false=code_block_5.out0)

# group: Z Coordinate
code_block_6 = CodeBlock(a=Z_3, b=height) { a+b/2; }
code_block_7 = CodeBlock { "z has no if"; }

# group: Point 1
byCoordinates = Point.ByCoordinates(x=if_, y=if_2, z=code_block_6)

code_block_8 = CodeBlock { 0; }
count = List.Count(list=byCoordinates)
code_block_9 = CodeBlock(a=count) { a-1; }
eq_2 = _ == code_block_9  # unwired: x
code_block_10 = CodeBlock { 1; }
add = _ + code_block_10  # unwired: x
loopWhile = LoopWhile(initialValue=code_block_8, continueWhile=eq_2, loopBody=add)
getItemAtIndex = List.GetItemAtIndex(list=byCoordinates, index=loopWhile)

# group: X Coordinate
code_block_11 = CodeBlock(a=X_3, b=width) { a-b/2; a; }
if_3 = RefactoredIf(test=eq, true=code_block_11.out0, false=code_block_11.a)

# group: Y Coordinate
code_block_12 = CodeBlock(a=Y_3, b=width) { a-b/2; a; }
if_4 = RefactoredIf(test=eq, true=code_block_12.a, false=code_block_12.out0)

# group: Z Coordinate
code_block_13 = CodeBlock(a=Z_3, b=height) { a-b/2; }
code_block_14 = CodeBlock { "z has no if"; }

# group: Point 2
byCoordinates_2 = Point.ByCoordinates(x=if_3, y=if_4, z=code_block_13)

getItemAtIndex_2 = List.GetItemAtIndex(list=byCoordinates_2, index=loopWhile)
wallOpening = Python(IN[0]=select_model_element, IN[1]=getItemAtIndex, IN[2]=getItemAtIndex_2)  # IronPython2
# ---------- wallOpening.python (31 lines) ----------
import clr
import sys

clr.AddReference("RevitNodes")
import Revit
clr.ImportExtensions(Revit.Elements)
clr.ImportExtensions(Revit.GeometryConversion)
clr.AddReference("RevitServices")
import RevitServices
from RevitServices.Persistence import DocumentManager 
from RevitServices.Transactions import TransactionManager 

clr.AddReference("RevitAPI")
clr.AddReference("RevitAPIUI")

import Autodesk 
from Autodesk.Revit.DB import *
from Autodesk.Revit.UI import *

doc = DocumentManager.Instance.CurrentDBDocument
uiapp = DocumentManager.Instance.CurrentUIApplication 
app = uiapp.Application 
uidoc = uiapp.ActiveUIDocument

#######OK NOW YOU CAN CODE########
mur=UnwrapElement(IN[0])
pa=IN[1].ToXyz()
pb=IN[2].ToXyz()
TransactionManager.Instance.EnsureInTransaction(doc)
a=doc.Create.NewOpening(mur,pa,pb)
TransactionManager.Instance.TransactionTaskDone()
# ----------------------------------------
height_2 = DoubleInput(0)  # graph input
width_2 = DoubleInput(0)  # graph input
ofRepeatedItem = List.OfRepeatedItem()  # unwired: item, amount
lastItem = List.LastItem()  # unwired: list
lastItem_2 = List.LastItem()  # unwired: list
wallOpening_2 = Python(IN[1]=lastItem, IN[2]=lastItem_2)  # IronPython2; unwired: IN[0]; same code as wallOpening
firstItem = List.FirstItem()  # unwired: list
firstItem_2 = List.FirstItem()  # unwired: list
wallOpening_3 = Python(IN[1]=firstItem, IN[2]=firstItem_2)  # IronPython2; unwired: IN[0]; same code as wallOpening
wallOpenings = Python(IN[0]=select_model_element, IN[1]=byCoordinates, IN[2]=byCoordinates_2)  # IronPython2
# ---------- wallOpenings.python (49 lines) ----------
import clr
import sys

clr.AddReference("RevitNodes")
import Revit
clr.ImportExtensions(Revit.Elements)
clr.ImportExtensions(Revit.GeometryConversion)
clr.AddReference("RevitServices")
import RevitServices
from RevitServices.Persistence import DocumentManager 
from RevitServices.Transactions import TransactionManager 

clr.AddReference("RevitAPI")
clr.AddReference("RevitAPIUI")

import Autodesk 
from Autodesk.Revit.DB import *
from Autodesk.Revit.UI import *

doc = DocumentManager.Instance.CurrentDBDocument
uiapp = DocumentManager.Instance.CurrentUIApplication 
app = uiapp.Application 
uidoc = uiapp.ActiveUIDocument

#######OK NOW YOU CAN CODE########
wall = UnwrapElement(IN[0])
points_a = [point.ToXyz() for point in IN[1]]
points_b = [point.ToXyz() for point in IN[2]]

# Check if the lists have the same length
if len(points_a) != len(points_b):
    print("Error: Lists of points must have the same length")
else:
    # Create a new transaction
    doc = UIDocument.ActiveDocument.Document
    TransactionManager.Instance.EnsureInTransaction(doc)

    try:
        # Iterate over the lists of points and create an opening for each pair
        for i, (point_a, point_b) in enumerate(zip(points_a, points_b)):
            print(f"Processing points {i}: {point_a} - {point_b}")
            opening = doc.Create.NewOpening(wall, point_a, point_b)
            print(f"Opening created: {opening}")
    except Exception as e:
        # Handle any exceptions that occur during the transaction
        print(f"Error creating openings: {e}")

    # Commit the transaction
    TransactionManager.Instance.TransactionTaskDone()
# ----------------------------------------
