# Dynamo graph 1.dyn (Dynamo 2.12.1.8246)

select_model_element = DSModelElementSelection()  # 1 picked in the model

# group: Kaboria
getLocation = Element.GetLocation(element=select_model_element)
code_block = CodeBlock { 1/2; }
pointAtParameter = Curve.PointAtParameter(curve=getLocation, param=code_block)
code_block_2 = CodeBlock { 1400; }
translate = Geometry.Translate(geometry=pointAtParameter, zTranslation=code_block_2)
X = Point.X(point=translate)
Y = Point.Y(point=translate)
Z = Point.Z(point=translate)

# group: Test Location
endPoint = Curve.EndPoint(curve=getLocation)
Y_2 = Point.Y(point=endPoint)
startPoint = Curve.StartPoint(curve=getLocation)
Y_3 = Point.Y(point=startPoint)
eq = Y_2 == Y_3
X_2 = Point.X(point=endPoint)
Z_2 = Point.Z(point=endPoint)
Z_3 = Point.Z(point=startPoint)
X_3 = Point.X(point=startPoint)

# group: Paramter Kaboria
width = CodeBlock { 1400; }
height = CodeBlock { 800; }

# group: X Coordinate
code_block_3 = CodeBlock(a=X, b=width) { a+b/2; a; }
if_ = RefactoredIf(test=eq, true=code_block_3.out0, false=code_block_3.a)

# group: Y Coordinate
code_block_4 = CodeBlock(a=Y, b=width) { a+b/2; a; }
if_2 = RefactoredIf(test=eq, true=code_block_4.a, false=code_block_4.out0)

# group: Z Coordinate
code_block_5 = CodeBlock(a=Z, b=height) { a+b/2; }
code_block_6 = CodeBlock { "z has no if"; }

# group: Point 1
byCoordinates = Point.ByCoordinates(x=if_, y=if_2, z=code_block_5)

# group: X Coordinate
code_block_7 = CodeBlock(a=X, b=width) { a-b/2; a; }
if_3 = RefactoredIf(test=eq, true=code_block_7.out0, false=code_block_7.a)

# group: Y Coordinate
code_block_8 = CodeBlock(a=Y, b=width) { a-b/2; a; }
if_4 = RefactoredIf(test=eq, true=code_block_8.a, false=code_block_8.out0)

# group: Z Coordinate
code_block_9 = CodeBlock(a=Z, b=height) { a-b/2; }
code_block_10 = CodeBlock { "z has no if"; }

# group: Point 2
byCoordinates_2 = Point.ByCoordinates(x=if_3, y=if_4, z=code_block_9)

wallOpening = Python(IN[0]=select_model_element, IN[1]=byCoordinates, IN[2]=byCoordinates_2)  # IronPython2
# ---------- wallOpening.python (31 lines) ----------
import clr
import sys

clr.AddReference("RevitNodes")
import Revit
clr.ImportExtensions(Revit.Elements)
clr.ImportExtensions(Revit.GeometryConversion)
clr.AddReference("RevitServices")
import RevitServices
from RevitServices.Persistence import DocumentManager 
from RevitServices.Transactions import TransactionManager 

clr.AddReference("RevitAPI")
clr.AddReference("RevitAPIUI")

import Autodesk 
from Autodesk.Revit.DB import *
from Autodesk.Revit.UI import *

doc = DocumentManager.Instance.CurrentDBDocument
uiapp = DocumentManager.Instance.CurrentUIApplication 
app = uiapp.Application 
uidoc = uiapp.ActiveUIDocument

#######OK NOW YOU CAN CODE########
mur=UnwrapElement(IN[0])
pa=IN[1].ToXyz()
pb=IN[2].ToXyz()
TransactionManager.Instance.EnsureInTransaction(doc)
a=doc.Create.NewOpening(mur,pa,pb)
TransactionManager.Instance.TransactionTaskDone()
# ----------------------------------------
