# Dynamo graph 21.dyn (Dynamo 2.12.1.8246)

# group: Convert Curtin Wall To Solid
select_model_element = DSModelElementSelection()  # 1 picked in the model
getLocation = Element.GetLocation(element=select_model_element)
ZAxis = Vector.ZAxis()
code_block = CodeBlock { "Unconnected Height"; }
getParameterValueByName = Element.GetParameterValueByName(element=select_model_element, parameterName=code_block)
code_block_2 = CodeBlock(a=getParameterValueByName) { a+2000; }
extrude = Curve.Extrude(curve=getLocation, direction=ZAxis, distance=code_block_2)
code_block_3 = CodeBlock { 100; }
code_block_4 = CodeBlock { true; }
thicken = Surface.Thicken(surface=extrude, thickness=code_block_3, both_sides=code_block_4)
