# Dynamo graph 31313.dyn (Dynamo 2.12.1.8246)
# packages: spring nodes 210.1.1, bimorphNodes 4.2.4, Rhythm 2023.7.1, Genius Loci 2023.1.23

# group: INPUT
boolean = BoolSelector(true)
select_the_plumbing_link = DSModelElementSelection()  # 1 picked in the model; graph input

categories = Categories("OST_RvtLinks")
all_elements_of_category = ElementsOfCategory(Category=categories)

# group: DUCT AND PIPES CATEGORY
categories_2 = Categories("OST_Walls")
string_from_object = FromObject(object=categories_2)
customISelectionFilter = Python(IN[0]=boolean, IN[1]=string_from_object)  # IronPython2
# ---------- customISelectionFilter.python (46 lines) ----------
#Copyright(c) 2017, john pierson
# @60secondrevit, http://sixtysecondrevit.com
#Sometimes a pick selection is better
#Based on a node from Dimitar Venkov

import clr

clr.AddReference("RevitAPIUI")
from  Autodesk.Revit.UI import *

clr.AddReference("RevitServices")
import RevitServices
from RevitServices.Persistence import DocumentManager
doc = DocumentManager.Instance.CurrentDBDocument
uidoc=DocumentManager.Instance.CurrentUIApplication.ActiveUIDocument

clr.AddReference("RevitNodes")
import Revit
clr.ImportExtensions(Revit.Elements)
TaskDialog.Show('Selection For Wall opening','Pick The Wall. in which you want to creat opening ducts , Press finish to complete.')

sel1 = uidoc.Selection
obt1 = Selection.ObjectType.Element
class CustomISelectionFilter(Selection.ISelectionFilter):
	def __init__(self, nom_categorie):
		self.nom_categorie = nom_categorie
	def AllowElement(self, e):
		if e.Category.Name == self.nom_categorie:
			return True
		else:
			return False
	def AllowReference(self, ref, point):
		return true
		
el_ref = sel1.PickObjects(obt1, CustomISelectionFilter(IN[1]), 'Pick elements of category, ' + (IN[1].lower()) + ' Press finish to complete.')
typelist = list()
idlist = list()
for i in el_ref:
	
	try:
		typelist.append(doc.GetElement(i.ElementId))
	except:
		typelist.apped(list())
		

OUT = typelist
# ----------------------------------------
code_block = CodeBlock { 1; }
chop = List.Chop(list=customISelectionFilter, lengths=code_block)
categories_3 = Categories("OST_DuctCurves")
ofCategory = Revit.LinkElement.OfCategory(linkInstance=all_elements_of_category, category=categories_3)
element_geometry_duct = Element.Geometry(element=ofCategory)

# group: is pipe intersect
geometry = Element.Geometry(element=customISelectionFilter)
flatten = List.Flatten(list=geometry)
doesIntersect = Geometry.DoesIntersect(geometry=element_geometry_duct, other=geometry@L1)
code_block_2 = CodeBlock { 2; }
flatten_2 = List.Flatten(list=doesIntersect@L3, amount=code_block_2)
filterByBoolMask = List.FilterByBoolMask(list=element_geometry_duct, mask=flatten_2@L2)
code_block_3 = CodeBlock { 2; }
flatten_3 = List.Flatten(list=filterByBoolMask.in@L3, amount=code_block_3)
watch = Watch(flatten_3)
intersectAll = Geometry.IntersectAll(geometry=flatten, others=watch@L1, lacing=CrossProduct)
code_block_4 = CodeBlock { 2; }
flatten_4 = List.Flatten(list=intersectAll@L3, amount=code_block_4)
centroid = Solid.Centroid(solid=flatten_4)
pruneDuplicates = Point.PruneDuplicates(points=centroid)
list_clean = Custom[List Clean](list=pruneDuplicates)  # package Genius Loci; Removes all Null, Empty and Blank from a list or nested list of lists.
filterByBoolMask_2 = List.FilterByBoolMask(list=ofCategory, mask=flatten_2@L2)
watch_2 = Watch(filterByBoolMask_2.in)

# group: Duct Data
code_block_5 = CodeBlock { "Height"; }
getParameterValueByName = Element.GetParameterValueByName(element=watch_2, parameterName=code_block_5)
clean = List.Clean(list=getParameterValueByName)
code_block_6 = CodeBlock { "Insulation Thickness"; }
getParameterValueByName_2 = Element.GetParameterValueByName(element=watch_2, parameterName=code_block_6)
code_block_7 = CodeBlock { "Width"; }
getParameterValueByName_3 = Element.GetParameterValueByName(element=watch_2, parameterName=code_block_7)
clean_2 = List.Clean(list=getParameterValueByName_3)
count = List.Count(list=clean_2@L2)
takeItems = List.TakeItems(list=getParameterValueByName_2, amount=count@L1)
code_block_8 = CodeBlock { 2; }
flatten_5 = List.Flatten(list=takeItems@L3, amount=code_block_8)

# group: Assign Width & Height
code_block_9 = CodeBlock(b=clean, a=flatten_5) { b+(a*2); }
string = StringInput("Width")
code_block_10 = CodeBlock(b=clean_2, a=flatten_5) { b+(a*2); }
string_2 = StringInput("Height")

# group: Get The Opening
string_3 = StringInput("ID-DUCT OPENING")
byName = Family.ByName(name=string_3)
types = Family.Types(family=byName)
ZAxis = Vector.ZAxis()
code_block_11 = CodeBlock(a=code_block_9) { -a/2; }
translate = Geometry.Translate(geometry=list_clean, direction=ZAxis, distance=code_block_11)
ꟿ_familyinstance_byhostandpoint = Custom[ꟿ FamilyInstance.ByHostAndPoint](host=chop, type=types, point=translate)  # package spring nodes; Creates hosted family instances(doors/windows) at the specified points. You can feed either a single family type or a unique type for each instance.

# group (continued): Assign Width & Height
ʳʰʸᵗʰᵐ_elements = Rhythm.Revit.Elements.Elements.SetParameterByNameTypeOrInstance(element=ꟿ_familyinstance_byhostandpoint, parameterName=string, value=code_block_10, lacing=Longest)
ʳʰʸᵗʰᵐ_elements_2 = Rhythm.Revit.Elements.Elements.SetParameterByNameTypeOrInstance(element=ꟿ_familyinstance_byhostandpoint, parameterName=string_2, value=code_block_9, lacing=Longest)

# group: Convert Curtin Wall To Solid
isEmpty = List.IsEmpty(list=geometry@L2)
filterByBoolMask_3 = List.FilterByBoolMask(list=chop, mask=isEmpty)
getLocation = Element.GetLocation(element=filterByBoolMask_3.in)
ZAxis_2 = Vector.ZAxis()
code_block_12 = CodeBlock { "Unconnected Height"; }
getParameterValueByName_4 = Element.GetParameterValueByName(element=filterByBoolMask_3.in, parameterName=code_block_12)
code_block_13 = CodeBlock(a=getParameterValueByName_4) { a+2000; }
extrude = Curve.Extrude(curve=getLocation, direction=ZAxis_2, distance=code_block_13)
code_block_14 = CodeBlock { 100; }
code_block_15 = CodeBlock { true; }
thicken = Surface.Thicken(surface=extrude, thickness=code_block_14, both_sides=code_block_15)

# group: Test Location
endPoint = Curve.EndPoint(curve=getLocation)
X = Point.X(point=endPoint)
Z = Point.Z(point=endPoint)
startPoint = Curve.StartPoint(curve=getLocation)
Z_2 = Point.Z(point=startPoint)
X_2 = Point.X(point=startPoint)
Y = Point.Y(point=endPoint)
Y_2 = Point.Y(point=startPoint)
eq = Y == Y_2

# group: Wall
flatten_6 = List.Flatten(list=filterByBoolMask_3.in)

flatten_7 = List.Flatten(list=thicken)

# group: is pipe intersect
code_block_16 = CodeBlock { 2; }
doesIntersect_2 = Geometry.DoesIntersect(geometry=element_geometry_duct, other=thicken@L1)
code_block_17 = CodeBlock { 2; }
flatten_8 = List.Flatten(list=doesIntersect_2@L3, amount=code_block_17)
filterByBoolMask_4 = List.FilterByBoolMask(list=element_geometry_duct, mask=flatten_8@L2)
code_block_18 = CodeBlock { 2; }
flatten_9 = List.Flatten(list=filterByBoolMask_4.in@L3, amount=code_block_18)
watch_3 = Watch(flatten_9)
intersectAll_2 = Geometry.IntersectAll(geometry=flatten_7, others=watch_3@L1, lacing=CrossProduct)
code_block_19 = CodeBlock { 2; }
flatten_10 = List.Flatten(list=intersectAll_2@L3, amount=code_block_19)
centroid_2 = Solid.Centroid(solid=flatten_10)
filterByBoolMask_5 = List.FilterByBoolMask(list=ofCategory, mask=flatten_8@L2)

pruneDuplicates_2 = Point.PruneDuplicates(points=centroid_2)

# group (continued): is pipe intersect
list_clean_2 = Custom[List Clean](list=pruneDuplicates_2)

# group: Points
X_3 = Point.X(point=list_clean_2)
Y_3 = Point.Y(point=list_clean_2)
Z_3 = Point.Z(point=list_clean_2)

# group: Duct Data
code_block_20 = CodeBlock { "Width"; }
getParameterValueByName_5 = Element.GetParameterValueByName(element=filterByBoolMask_5.in, parameterName=code_block_20)
clean_3 = List.Clean(list=getParameterValueByName_5)
code_block_21 = CodeBlock { "Insulation Thickness"; }
getParameterValueByName_6 = Element.GetParameterValueByName(element=filterByBoolMask_5.in, parameterName=code_block_21)
count_2 = List.Count(list=clean_3@L2)
takeItems_2 = List.TakeItems(list=getParameterValueByName_6, amount=count_2@L1)
code_block_22 = CodeBlock { 2; }
flatten_11 = List.Flatten(list=takeItems_2@L3, amount=code_block_22)
code_block_23 = CodeBlock { "Height"; }
getParameterValueByName_7 = Element.GetParameterValueByName(element=filterByBoolMask_5.in, parameterName=code_block_23)
clean_4 = List.Clean(list=getParameterValueByName_7)

# group: Get Dimntions
code_block_24 = CodeBlock(b=clean_3, a=flatten_11) { b+(a*2); }
code_block_25 = CodeBlock(b=clean_4, a=flatten_11) { b+(a*2); }

# group: Z Coordinate
code_block_26 = CodeBlock { "z has no if"; }
code_block_27 = CodeBlock(a=Z_3, b=code_block_25) { a-b/2; }

# group: Z Coordinate
code_block_28 = CodeBlock { "z has no if"; }
code_block_29 = CodeBlock(a=Z_3, b=code_block_25) { a+b/2; }

# group: X Coordinate
code_block_30 = CodeBlock(a=X_3, b=code_block_24) { a+b/2; a; }
if_ = RefactoredIf(test=eq, true=code_block_30.out0, false=code_block_30.a)
code_block_31 = CodeBlock { 2; }
flatten_12 = List.Flatten(list=if_, amount=code_block_31)

# group: Y Coordinate
code_block_32 = CodeBlock(a=Y_3, b=code_block_24) { a+b/2; a; }
if_2 = RefactoredIf(test=eq, true=code_block_32.a, false=code_block_32.out0)
code_block_33 = CodeBlock { 2; }
flatten_13 = List.Flatten(list=if_2, amount=code_block_33)

# group: Point 1
byCoordinates = Point.ByCoordinates(x=flatten_12, y=flatten_13, z=code_block_29)

# group: X Coordinate
code_block_34 = CodeBlock(a=X_3, b=code_block_24) { a-b/2; a; }
if_3 = RefactoredIf(test=eq, true=code_block_34.out0, false=code_block_34.a)
code_block_35 = CodeBlock { 2; }
flatten_14 = List.Flatten(list=if_3, amount=code_block_35)

# group: Y Coordinate
code_block_36 = CodeBlock(a=Y_3, b=code_block_24) { a-b/2; a; }
if_4 = RefactoredIf(test=eq, true=code_block_36.a, false=code_block_36.out0)
code_block_37 = CodeBlock { 2; }
flatten_15 = List.Flatten(list=if_4, amount=code_block_37)

# group: Point 2
byCoordinates_2 = Point.ByCoordinates(x=flatten_14, y=flatten_15, z=code_block_27)

# group: Filter
code_block_38 = CodeBlock { 0; 1; 2; }
getItemAtIndex = List.GetItemAtIndex(list=flatten_6, index=code_block_38.out0)
code_block_39 = CodeBlock { 0; 1; 2; }
getItemAtIndex_2 = List.GetItemAtIndex(list=byCoordinates, index=code_block_39.out0)
code_block_40 = CodeBlock { 0; 1; 2; }
getItemAtIndex_3 = List.GetItemAtIndex(list=byCoordinates_2, index=code_block_40.out0)
getItemAtIndex_4 = List.GetItemAtIndex(list=flatten_6, index=code_block_38.out1)
getItemAtIndex_5 = List.GetItemAtIndex(list=byCoordinates, index=code_block_39.out1)
getItemAtIndex_6 = List.GetItemAtIndex(list=byCoordinates_2, index=code_block_40.out1)
getItemAtIndex_7 = List.GetItemAtIndex(list=flatten_6, index=code_block_38.out2)
getItemAtIndex_8 = List.GetItemAtIndex(list=byCoordinates, index=code_block_39.out2)
getItemAtIndex_9 = List.GetItemAtIndex(list=byCoordinates_2, index=code_block_40.out2)

# group: Opening
flatten_16 = List.Flatten(list=getItemAtIndex_2)
flatten_17 = List.Flatten(list=getItemAtIndex_3)
wallOpenings = Python(IN[0]=getItemAtIndex, IN[1]=flatten_16, IN[2]=flatten_17)  # "Create.WallOpenings"; IronPython2
# ---------- wallOpenings.python (41 lines) ----------
import clr
import sys

clr.AddReference("RevitNodes")
import Revit
clr.ImportExtensions(Revit.Elements)
clr.ImportExtensions(Revit.GeometryConversion)
clr.AddReference("RevitServices")
import RevitServices
from RevitServices.Persistence import DocumentManager 
from RevitServices.Transactions import TransactionManager 

clr.AddReference("RevitAPI")
clr.AddReference("RevitAPIUI")

import Autodesk 
from Autodesk.Revit.DB import *
from Autodesk.Revit.UI import *

doc = DocumentManager.Instance.CurrentDBDocument
uiapp = DocumentManager.Instance.CurrentUIApplication 
app = uiapp.Application 
uidoc = uiapp.ActiveUIDocument

#######OK NOW YOU CAN CODE########
mur=UnwrapElement(IN[0])
points_list1 = IN[1]
points_list2 = IN[2]

# Ensure both lists have the same length
if len(points_list1) != len(points_list2):
    raise ValueError("Both lists of points must have the same length.")

TransactionManager.Instance.EnsureInTransaction(doc)

for pa, pb in zip(points_list1, points_list2):
    pa_xyz = pa.ToXyz()
    pb_xyz = pb.ToXyz()
    doc.Create.NewOpening(mur, pa_xyz, pb_xyz)

TransactionManager.Instance.TransactionTaskDone()
# ----------------------------------------
flatten_18 = List.Flatten(list=getItemAtIndex_5)
flatten_19 = List.Flatten(list=getItemAtIndex_6)
wallOpenings_2 = Python(IN[0]=getItemAtIndex_4, IN[1]=flatten_18, IN[2]=flatten_19)  # "Create.WallOpenings"; IronPython2; same code as wallOpenings
flatten_20 = List.Flatten(list=getItemAtIndex_8)
flatten_21 = List.Flatten(list=getItemAtIndex_9)
wallOpenings_3 = Python(IN[0]=getItemAtIndex_7, IN[1]=flatten_20, IN[2]=flatten_21)  # "Create.WallOpenings"; IronPython2; same code as wallOpenings
